# Grasshopper definition createSimpleBoxCase.gh (Grasshopper 0.9.76)
# plug-ins: Python Interpreter

jagged = SettingsSpeed()
srf = Surface(<surface referenced from the Rhino model>)
brep = Brep(<brep referenced from the Rhino model>)
srf_2 = Surface(<surface referenced from the Rhino model>)
wires = BrepWireframe(Brep=brep, Density=-1)

# ---- group: butterfly face
python = PythonScript(geo=srf, name="west_window", BC="patch", meshSet=jagged)  # -> out, BFSrf; inputs geo: list of GeometryBase
# ---------- python: Python ----------
import sys
sys.path.append("C:/Users/Administrator/Dropbox/ladybug/Butterfly")

import butterfly
from butterfly.gh import BFSurface

reload(butterfly)
reload(butterfly.gh)

BFSrf = BFSurface(name, geo, BC, meshSet)
# ---------- end python ----------

# ----
python_2 = PythonScript(geo=brep, name="room", BC="wall", meshSet=jagged)  # -> out, BFSrf; inputs geo: list of GeometryBase; same code as python
python_3 = PythonScript(geo=srf_2, name="east_window", BC="patch", meshSet=jagged)  # -> out, BFSrf; inputs geo: list of GeometryBase; same code as python
brep_2 = Brep([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])
number_slider = Slider(1.1, range=0..10)
bbox = BoundingBox(Content=brep, Plane=PlaneXY(0, 0, 0), UnionBox=True)  # -> Box, Box_2
python_4 = PythonScript(geo=brep_2, nDivXYZ="{1,1,1}", gradXYZ="{1,1,1}")  # -> out, block; inputs geo: Brep, nDivXYZ: Point3d, gradXYZ: Point3d
# ---------- python_4: Python ----------
import sys
sys.path.append("C:/Users/Administrator/Dropbox/ladybug/Butterfly")

import butterfly
from butterfly.gh import Block

reload(butterfly)
reload(butterfly.gh)

block = Block(geo, nDivXYZ, gradXYZ)
# ---------- end python_4 ----------
volume = Volume(Geometry=bbox.Box)  # -> Volume, Centroid
wires_2 = BrepWireframe(Brep=brep_2, Density=-1)
scale_nu = ScaleNU(Geometry=bbox.Box, Plane=volume.Centroid, ScaleX=number_slider, ScaleY=number_slider, ScaleZ=1)  # -> Geometry, Transform
python_5 = PythonScript(name="innerflow_2", BFSrfs=flatten([python_2.BFSrf, python.BFSrf, python_3.BFSrf]))  # -> out, c; inputs BFSrfs: list, blocks: list; disabled
# ---------- python_5: Python ----------
import sys
sys.path.append("C:/Users/Administrator/Dropbox/ladybug/Butterfly")

import butterfly
from butterfly.foamfile import FoamFile
from butterfly.core import Case

reload(butterfly)
reload(butterfly.blockMeshDict)
reload(butterfly.foamfile)
reload(butterfly.core)

c = Case.fromBlocks(BFSrfs, blocks, 1)
c.write(name)
# ---------- end python_5 ----------
python_6 = PythonScript(
    name="innerflow_3",
    BFSrfs=flatten([python_2.BFSrf, python.BFSrf, python_3.BFSrf]),
    bbox=scale_nu.Geometry,
    nDivXYZ="{1,1,1}",
    gradXYZ="{1,1,1}")  # -> out, a; inputs BFSrfs: list, bbox: GeometryBase, nDivXYZ: Point3d, gradXYZ: Point3d
# ---------- python_6: Python ----------
import sys
sys.path.append("C:/Users/Administrator/Dropbox/ladybug/Butterfly")

import butterfly
from butterfly.core import Case
from butterfly.gh import BFSurface, Block
from butterfly.blockMeshDict import BlockMeshDict
reload(butterfly)
reload(butterfly.core)
reload(butterfly.blockMeshDict)

# create blockMeshDict based on BBox
block = Block(bbox, nDivXYZ, gradXYZ)
BBBFSurface = BFSurface('boundingbox', [bbox], 'wall')
blockMeshDict = BlockMeshDict(1, [BBBFSurface], [block])

# create OpenFoam Case
c = Case(BFSrfs, blockMeshDict, snappyHexMesh=True)
c.write(name)
# ---------- end python_6 ----------
panel = Panel(python_5.out)
panel_2 = Panel(python_6.out)
panel_3 = Panel("C:\Users\Administrator\Dropbox\ladybug\Butterfly\other_files\OpenFOAM_Sample_Files\innerflow\constant\polyMesh")
python_7 = PythonScript(studyFolder=panel_3)  # -> mesh
# ---------- python_7: Python ----------
import Rhino as rc
import os

def splitLine(l, t=float):
    return tuple(t(s) for s in l.split('(')[-1].replace(')', '').split())

def OFMeshToRhino(studyFolder):
    pf = os.path.join(studyFolder, 'points')
    ff = os.path.join(studyFolder, 'faces')
    
    if not os.path.isfile(pf) or not os.path.isfile(ff):
        print "Can't find point and faces file."
        return
        
    # read points
    with open(pf, 'rb') as ptFile:
       for l in xrange(18):
           ptFile.readline()
       
       nPoints = int(ptFile.readline())
       ptFile.readline()
       pts = tuple(
                   rc.Geometry.Point3d(*splitLine(ptFile.readline()))
                   for pt in xrange(nPoints)
            )
    
    # read faces
    with open(ff, 'rb') as faceFile:
       for l in xrange(18):
           faceFile.readline()
       
       nFaces = int(faceFile.readline())
       faceFile.readline()
       faces = tuple((splitLine(faceFile.readline(), t=int))
                   for pt in xrange(nFaces)
            )
    
    # create the mesh
    mesh = rc.Geometry.Mesh()

    for p in pts:
        mesh.Vertices.Add(p)

    for face in faces:
        if len(face) < 5:
            mesh.Faces.AddFace(*face)
        else:
            mesh.Faces.AddFace(*face[:3])
            mesh.Faces.AddFace(*(0,) + (face[3:]))
    
    return mesh

mesh = OFMeshToRhino(studyFolder)
# ---------- end python_7 ----------
pt = Point(Point(5.246792205, 6, 2.49108698))
xz = XZPlane(Origin=pt)
xy = XYPlane(Origin=pt)
yz = YZPlane(Origin=pt)
mesh = Mesh(python_7)
sec = MeshPlane(Mesh=mesh, Plane=xz)
